# Grasshopper definition volumen slicen.gh (Grasshopper 1.0.8)
# plug-ins: Human

pipeline = GeometryPipeline(
    GroupByLayer=False,
    GroupByType=False,
    IncludeHidden=False,
    IncludeLocked=True,
    LayerFilter="Entwurf*",
    NameFilter="geb",
    SublayerFiltering=True,
    TypeFilter=1073741848)

py3 = Python3Script(reset=Button())  # -> a
# ---------- py3: Python ----------
from compas_ghpython import unload_modules

unload_modules("jh_ghp_tools")

if reset:
    unload_modules("jh_ghp_tools")
# ---------- end py3 ----------

py3_2 = Python3Script(B=pipeline, h_eg="4.0", h_og="3.0", h_tot="40")  # -> B, A; inputs B: list of Brep, h_eg: Double, h_og: Double, h_tot: Double
# ---------- py3_2: Python ----------
from jh_ghp_tools import volumen_slicen
import ghpythonlib.components as gh


B, A = volumen_slicen(B, h_eg, h_og, h_tot)
# ---------- end py3_2 ----------
wires = BrepWireframe(Brep=py3_2.B, Density=-1)
panel = Panel("""soll
4029""")
panel_2 = Panel(py3_2.A)
previewlw = CustomPreviewLineweights(Geometry=wires, Shader=ColourSwatch(SwatchColor=RGB(0, 0, 0)), Absolute=False)
pt = Point(Point(93.79772034, 21.14622887, 0))
tag = TextTag3D(Location=pt, Text=py3_2.A, Size="2", Colour=ColourSwatch(SwatchColor=RGB(0, 0, 0)), Justification=5)
